# Grasshopper definition Automata_Mangrove.gh (Grasshopper 1.0.7)
# plug-ins: Kangaroo2 Components, Anemone, Shortest Walk in Gh, LunchBox, Pufferfish

point = Point([Point(20, -20, 0), Point(20, 20, 0), Point(-20, -20, 0), Point(-20, 20, 0), Point(0, -40, 0), Point(-10, -30, 0), Point(10, -30, 0), Point(0, 40, 0), Point(-10, 30, 0), Point(10, 30, 0), Point(30, -10, 0), Point(30, 10, 0), Point(40, 0, 0), Point(-30, -10, 0), Point(-30, 10, 0), Point(-40, 0, 0), Point(-20, 0, 0), Point(0, -20, 0), Point(0, 20, 0), Point(20, 0, 0), Point(-10, -10, 0), Point(-10, 10, 0), Point(10, 10, 0), Point(10, -10, 0)])
point_2 = Point([Point(-20, 20, 0), Point(-20, 10, 0), Point(-20, -20, 0), Point(-20, -10, 0), Point(-30, 0, 0), Point(0, 30, 0), Point(0, -30, 0), Point(20, 20, 0), Point(20, 10, 0), Point(20, -20, 0), Point(20, -10, 0), Point(30, 0, 0)])
point_3 = Point([Point(-70, 30, 0), Point(-60, 30, 0), Point(-50, 30, 0), Point(-50, 20, 0), Point(-30, 70, 0), Point(-30, 60, 0)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])
point_4 = Point([Point(-10, -10, 0), Point(10, -10, 0), Point(10, 10, 0), Point(-10, 10, 0), Point(30, -50, 0), Point(40, -40, 0), Point(20, -40, 0), Point(10, -30, 0), Point(20, -20, 0), Point(30, -10, 0)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])
point_5 = Point([Point(-50, -30, 0), Point(-50, -20, 0), Point(-40, -30, 0), Point(-30, -50, 0), Point(-30, -40, 0), Point(-20, -50, 0)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])

# ---- group: Upper_Part / Directions for moving
rectangle = Rectangle(Plane=PlaneXY(0, 0, 0), XSize="-10 to 10", YSize="-10 to 10", Radius=0)  # -> Rectangle, Length
discontinuity = Discontinuity(Curve=rectangle.Rectangle, Level=1)  # -> Points, Parameters
explode = Explode(Curve=rectangle.Rectangle, Recursive=True)  # -> Segments, Vertices
evaluate_length = EvaluateLength(Curve=explode.Segments, Length="1", Normalized=True)  # -> Point, Tangent, Parameter
construct_point = ConstructPoint(XCoordinate=0, YCoordinate=0, ZCoordinate=0)
merge = Merge(Data1=discontinuity.Points, Data2=evaluate_length.Point)
vector_2pt = Vector2Pt(PointA=construct_point, PointB=merge, Unitize=False)  # -> Vector, Length

# ---- group: Lower_Part
number_slider = Slider(-60, range=-100..100)
point_6 = Point(point_5)
bounding_rectangle = BoundingRectangle(Geometry=point_6, Plane=PlaneXY(0, 0, 0), Axis=0, Slide=0, Union=True)  # -> Bounding, DimensionX, DimensionY
unit_z = UnitZ(Factor=number_slider)
area = Area(Geometry=bounding_rectangle.Bounding)  # -> Area, Centroid
extrude = Extrude(Base=bounding_rectangle.Bounding, Direction=unit_z)
number_slider_2 = Slider(14, range=0..20)
move = Move(Geometry=area.Centroid, Motion=unit_z)  # -> Geometry, Transform
grid_structure = GridStructure(Surface=bounding_rectangle.Bounding, UDivisions=number_slider_2, VDivisions=number_slider_2)  # -> StructureLines, StructureNodes
number_slider_3 = Slider(10, range=0..10)
absolute = Absolute(Value=number_slider)
negative = Negative(Value=number_slider_3)
division = Division(A=absolute, B=number_slider_3)
point_7 = Point(grid_structure.StructureNodes)
series = Series(Start=negative, Step=negative, Count=division)
unit_z_2 = UnitZ(Factor=series)
move_2 = Move(Geometry=graft(point_7), Motion=unit_z_2)  # -> Geometry, Transform
unit_z_3 = UnitZ(Factor=Slider(-10, range=-100..100))
populate_3d = Populate3D(Region=extrude, Count=Slider(170, range=0..1000), Seed=1)
move_3 = Move(Geometry=move.Geometry, Motion=unit_z_3)  # -> Geometry, Transform
point_8 = Point([move.Geometry, point_6, populate_3d, move_3.Geometry, move_2.Geometry])
proximity_3d = Proximity3D(Points=flatten(point_8), Group=5)  # -> Links, Topology
line = Line(StartPoint=move.Geometry, EndPoint=move_3.Geometry)
line_2 = Line(StartPoint=move.Geometry, EndPoint=point_6)
curve = Curve(flatten(proximity_3d.Links))
panel = Panel(line_2)
shortest_walk = ShortestWalk(Curves=curve, WantedPath=line_2)  # -> ShortestWalk, Succession, Direction, Length
curve_2 = Curve([line, shortest_walk.ShortestWalk])
explode_2 = Explode(Curve=curve_2, Recursive=True)  # -> flatten(Segments), Vertices
sort_duplicate_curves = SortDuplicateCurves(Curves=explode_2.Segments)  # -> UniqueCurves, Indices

# ---- group: Root
number_slider_4 = Slider(250, range=0..360)
angles_list = Panel("""45
135
200
250
315""")

point_9 = Point(move_3.Geometry)
negative_2 = Negative(Value=Slider(10, range=0..10))
unit_z_4 = UnitZ(Factor=negative_2)
move_4 = Move(Geometry=point_9, Motion=unit_z_4)  # -> Geometry, Transform
unit_x = UnitX(Factor=Slider(40, range=0..50))
line_3 = Line(StartPoint=point_9, EndPoint=move_4.Geometry)
move_5 = Move(Geometry=move_4.Geometry, Motion=unit_x)  # -> Geometry, Transform
flip_curve = FlipCurve(Curve=line_3)  # -> Curve, Flag
line_4 = Line(StartPoint=move_4.Geometry, EndPoint=move_5.Geometry)
rotate_axis = RotateAxis(Geometry=line_4, Angle=graft(degrees(angles_list)), Axis=flip_curve.Curve)  # -> Geometry, Transform
end_points = EndPoints(Curve=rotate_axis.Geometry)  # -> Start, End
negative_3 = Negative(Value=Slider(40, range=0..50))
unit_z_5 = UnitZ(Factor=negative_3)
move_6 = Move(Geometry=end_points.End, Motion=unit_z_5)  # -> Geometry, Transform
line_5 = Line(StartPoint=move_4.Geometry, EndPoint=move_6.Geometry)
bounding_box = BoundingBox(Content=flatten(line_5), Plane=PlaneXY(0, 0, 0))  # -> Box, Box_2
populate_3d_2 = Populate3D(Region=bounding_box.Box, Count=Slider(1000, range=0..1000), Seed=1, Points=point_9)
proximity_3d_2 = Proximity3D(Points=flatten(populate_3d_2), Group=5)  # -> flatten(Links), Topology
shortest_walk_2 = ShortestWalk(Curves=proximity_3d_2.Links, WantedPath=line_5)  # -> ShortestWalk, Succession, Direction, Length
end_points_2 = EndPoints(Curve=shortest_walk_2.ShortestWalk)  # -> Start, End
explode_3 = Explode(Curve=flatten(shortest_walk_2.ShortestWalk), Recursive=True)  # -> flatten(Segments), Vertices
sort_duplicate_points = SortDuplicatePoints(Points=end_points_2.Start)  # -> UniquePoints, Indices
sort_duplicate_curves_2 = SortDuplicateCurves(Curves=explode_3.Segments)  # -> UniqueCurves, Indices
line_6 = Line(StartPoint=move_4.Geometry, EndPoint=sort_duplicate_points.UniquePoints)
explode_4 = Explode(Curve=flatten(sort_duplicate_curves_2.UniqueCurves), Recursive=True)  # -> flatten(Segments), Vertices
explode_5 = Explode(Curve=flatten(line_6), Recursive=True)  # -> flatten(Segments), Vertices
sort_duplicate_curves_3 = SortDuplicateCurves(Curves=explode_4.Segments)  # -> UniqueCurves, Indices
sort_duplicate_curves_4 = SortDuplicateCurves(Curves=explode_5.Segments)  # -> UniqueCurves, Indices
scale = Scale(
    Geometry=flatten(sort_duplicate_curves_3.UniqueCurves),
    Center=flatten(sort_duplicate_points.UniquePoints),
    Factor=Slider(2, range=0..10))  # -> Geometry, Transform
curve_3 = Curve(flatten([line_3, scale.Geometry, sort_duplicate_curves_4.UniqueCurves]))

# ---- group: Root / Angle Finder
rotate_axis_2 = RotateAxis(Geometry=line_4, Angle=degrees(number_slider_4), Axis=flip_curve.Curve)  # -> Geometry, Transform

# ---- group: Upper_Part
starting_generation = Point(point_5)
loop_start = LoopStart(Repeat=Slider(10, range=0..10), Trigger=Button(), Data=starting_generation, D1=starting_generation)  # -> port, Counter, Data, Data_2
living_points = Point(loop_start.Data)
point_10 = Point(living_points)
list_length = ListLength(List=starting_generation)
series_2 = Series(Start="0", Step=1, Count=list_length)
list_length_2 = ListLength(List=point_5)
series_3 = Series(Start="0", Step=1, Count=list_length_2)

# ---- group: Upper_Part / DEAD points
move_7 = Move(Geometry=living_points, Motion=graft(vector_2pt.Vector))  # -> flatten(Geometry), Transform
removeduplicatepts = RemoveDuplicatePts(Points=move_7.Geometry, Tolerance=0.01)
merge_2 = Merge(Data1=living_points, Data2=removeduplicatepts)  # -> flatten(Result)
cull_duplicates = CullDuplicates(Points=merge_2, Tolerance=0.1, CullMode=2)  # -> Points, Indices, Valence
surrounding_dead_points = Point(cull_duplicates.Points)

# ---- group: Upper_Part / # of neighbors each LIVE point has
rectangle_2 = Rectangle(Plane=point_10, XSize="-10 to 10", YSize="-10 to 10", Radius=0)  # -> Rectangle, Length
point_in_curve = PointInCurve(Point=point_10, Curve=graft(rectangle_2.Rectangle))  # -> Relationship, Point
equality = Equality(FirstNumber=point_in_curve.Relationship, SecondNumber="1")  # -> Equality, Inequality
number = Number(equality.Equality)
mass_addition = MassAddition(Input=number)  # -> flatten(Result), PartialResults

# ---- group: Upper_Part / # of neighbors each DEAD point has
rectangle_3 = Rectangle(Plane=surrounding_dead_points, XSize="-10 to 10", YSize="-10 to 10", Radius=0)  # -> Rectangle, Length
point_in_curve_2 = PointInCurve(Point=living_points, Curve=graft(rectangle_3.Rectangle))  # -> Relationship, Point
equality_2 = Equality(FirstNumber=point_in_curve_2.Relationship, SecondNumber="1")  # -> Equality, Inequality
number_2 = Number(equality_2.Equality)
mass_addition_2 = MassAddition(Input=number_2)  # -> flatten(Result), PartialResults

# ---- group: Upper_Part
multiplication = Multiplication(A=loop_start.Counter, B="10")
addition = Addition(A=multiplication, B="10")
unit_z_6 = UnitZ(Factor=addition)

point_11 = Point(starting_generation)
bounding_rectangle_2 = BoundingRectangle(Geometry=point_11, Plane=PlaneXY(0, 0, 0), Axis=0, Slide=0, Union=True)  # -> Bounding, DimensionX, DimensionY
offset_curve = OffsetCurve(Curve=bounding_rectangle_2.Bounding, Distance="10", Corners=1)
populate_2d = Populate2D(Region=offset_curve, Count=list_length, Seed=1)

how_many_neighbors_each_living_cell_has = Number(mass_addition.Result)
how_many_neighbors_each_dead_point_has = Number(mass_addition_2.Result)
equality_3 = Equality(FirstNumber=how_many_neighbors_each_dead_point_has, SecondNumber=Slider(3, range=0..10))  # -> Equality, Inequality
cull_pattern = CullPattern(List=surrounding_dead_points, CullPattern=invert(equality_3.Inequality))
became_alive = Point(cull_pattern)
point_12 = Point(populate_2d)
closest_points = ClosestPoints(Point=point_12, Cloud=starting_generation, Count=3)  # -> ClosestPoint, CPIndex, Distance
sort_duplicate_points_2 = SortDuplicatePoints(Points=flatten(closest_points.ClosestPoint))  # -> UniquePoints, Indices
list_item = ListItem(List=sort_duplicate_points_2.UniquePoints, Index=series_3, Wrap=True)

# ---- group: Upper_Part / Death check for LIVING cells
smaller_than = SmallerThan(FirstNumber=how_many_neighbors_each_living_cell_has, SecondNumber=Slider(2, range=0..8))  # -> SmallerThan, OrEqualTo
larger_than = LargerThan(FirstNumber=how_many_neighbors_each_living_cell_has, SecondNumber=Slider(3, range=0..8))  # -> LargerThan, OrEqualTo
gate_or = GateOr(A=smaller_than.SmallerThan, B=larger_than.LargerThan)

# ---- group: Upper_Part (continued)
cull_pattern_2 = CullPattern(List=living_points, CullPattern=invert(gate_or))
stayed_alive = Point(cull_pattern_2)
merge_3 = Merge(Data1=stayed_alive, Data2=became_alive)  # -> flatten(Result)
next_generation = Point(merge_3)
move_8 = Move(Geometry=next_generation, Motion=unit_z_6)  # -> Geometry, Transform
merge_4 = Merge(Data1=loop_start.Data_2, Data2=move_8.Geometry)
loop_end = LoopEnd(
    port=loop_start.port,
    Exit=False,
    Data=next_generation,
    Data_2=merge_4,
    TimeOutVal=0,
    pausedState=False,
    state="Constant output")  # -> Data, D1
recorded_points = Point(loop_end.D1)
reverse_list = ReverseList(List=recorded_points)
panel_2 = Panel(reverse_list)
list_item_2 = ListItem(List=reverse_list, Index=series_2, Wrap=True)
data_dam = DataDam(DataDataA=recorded_points, BufferDelay=10000000, BufferMode=2)
point_order = PointOrder(Points=recorded_points)
proximity_3d_3 = Proximity3D(Points=data_dam, Group=5)  # -> flatten(Links), Topology

point_13 = Point(list_item_2)
bounding_rectangle_3 = BoundingRectangle(Geometry=point_13, Plane=PlaneXY(0, 0, 0), Axis=0, Slide=0, Union=True)  # -> Bounding, DimensionX, DimensionY
offset_curve_2 = OffsetCurve(Curve=bounding_rectangle_3.Bounding, Distance="10", Corners=1)
populate_2d_2 = Populate2D(Region=offset_curve_2, Count=list_length, Seed=1)

point_14 = Point(populate_2d_2)
closest_points_2 = ClosestPoints(Point=point_14, Cloud=list_item_2, Count=3)  # -> ClosestPoint, CPIndex, Distance
sort_duplicate_points_3 = SortDuplicatePoints(Points=flatten(closest_points_2.ClosestPoint))  # -> UniquePoints, Indices
list_item_3 = ListItem(List=sort_duplicate_points_3.UniquePoints, Index=series_3, Wrap=True)
line_7 = Line(StartPoint=graft(list_item), EndPoint=graft(list_item_3))
shortest_walk_3 = ShortestWalk(Curves=proximity_3d_3.Links, WantedPath=line_7)  # -> ShortestWalk, Succession, Direction, Length
explode_6 = Explode(Curve=flatten(shortest_walk_3.ShortestWalk), Recursive=True)  # -> flatten(Segments), Vertices
sort_duplicate_curves_5 = SortDuplicateCurves(Curves=explode_6.Segments)  # -> UniqueCurves, Indices
explode_7 = Explode(Curve=flatten(sort_duplicate_curves_5.UniqueCurves), Recursive=True)  # -> flatten(Segments), Vertices
sort_duplicate_curves_6 = SortDuplicateCurves(Curves=explode_7.Segments)  # -> UniqueCurves, Indices

# ----
curve_4 = Curve(flatten([sort_duplicate_curves.UniqueCurves, sort_duplicate_curves_6.UniqueCurves, curve_3]))
multipipe = MultiPipe(
    Curves=simplify(curve_4),
    NodeSize=Slider(2, range=0..5),
    EndOffset=Slider(0, range=0..1),
    StrutSize=1,
    Segment=Slider(0, range=0..1),
    KinkAngle=0.6,
    CubeFit=0,
    Caps=Slider(0, range=0..2))
