# Grasshopper definition Automata_Mangrove_Base.gh (Grasshopper 1.0.7)
# plug-ins: Kangaroo2 Components, Anemone, MarchingCubes, Weaverbird

# ---- group: Directions for moving
rectangle = Rectangle(Plane=PlaneXY(0, 0, 0), XSize="-10 to 10", YSize="-10 to 10", Radius=0)  # -> Rectangle, Length
explode = Explode(Curve=rectangle.Rectangle, Recursive=True)  # -> Segments, Vertices
discontinuity = Discontinuity(Curve=rectangle.Rectangle, Level=1)  # -> Points, Parameters
evaluate_length = EvaluateLength(Curve=explode.Segments, Length="0.5", Normalized=True)  # -> Point, Tangent, Parameter
construct_point = ConstructPoint(XCoordinate=0, YCoordinate=0, ZCoordinate=0)
merge = Merge(Data1=discontinuity.Points, Data2=evaluate_length.Point)
vector_2pt = Vector2Pt(PointA=construct_point, PointB=merge, Unitize=False)  # -> Vector, Length

# ----
points_derived_from_colors = Point([Point(90, -50, 0), Point(70, 60, 0), Point(10, 60, 0), Point(-70, 20, 0), Point(40, 120, 0), Point(110, 40, 0), Point(130, 70, 0), Point(-20, 0, 0), Point(60, 40, 0), Point(50, 50, 0)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])
square = Point([Point(89.27712493, -140, 0), Point(89.27712493, -150, 0), Point(99.27712493, -160, 0), Point(159.2771249, -70, 0), Point(179.2771249, -20, 0), Point(89.27712493, -90, 0)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])
hammerhead_spaceship = Point([Point(0, 0, 0), Point(-10, 10, 0), Point(-20, 20, 0), Point(-30, 30, 0), Point(-60, 40, 0), Point(-70, 50, 0)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])
canoe = Point([Point(0, 0, 0), Point(10, 10, 0), Point(20, 20, 0), Point(20, 30, 0), Point(10, 30, 0), Point(-10, -10, 0), Point(-20, -10, 0), Point(-20, 0, 0)])
starting_generation = Point()
loop_start = LoopStart(Repeat=Slider(60, range=0..100), Trigger=Button(), Data=starting_generation, D1=starting_generation)  # -> port, Counter, Data, Data_2
living_points = Point(loop_start.Data)

# ---- group: DEAD points
move = Move(Geometry=living_points, Motion=graft(vector_2pt.Vector))  # -> flatten(Geometry), Transform
removeduplicatepts = RemoveDuplicatePts(Points=move.Geometry, Tolerance=0.01)
merge_2 = Merge(Data1=living_points, Data2=removeduplicatepts)  # -> flatten(Result)
cull_duplicates = CullDuplicates(Points=merge_2, Tolerance=0.1, CullMode=2)  # -> Points, Indices, Valence
surrounding_dead_points = Point(cull_duplicates.Points)

# ---- group: # of neighbors each LIVE point has
point = Point(living_points)
rectangle_2 = Rectangle(Plane=point, XSize="-10 to 10", YSize="-10 to 10", Radius=0)  # -> Rectangle, Length
point_in_curve = PointInCurve(Point=point, Curve=graft(rectangle_2.Rectangle))  # -> Relationship, Point
equality = Equality(FirstNumber=point_in_curve.Relationship, SecondNumber="1")  # -> Equality, Inequality
number = Number(equality.Equality)
mass_addition = MassAddition(Input=number)  # -> flatten(Result), PartialResults

# ---- group: # of neighbors each DEAD point has
rectangle_3 = Rectangle(Plane=surrounding_dead_points, XSize="-10 to 10", YSize="-10 to 10", Radius=0)  # -> Rectangle, Length
point_in_curve_2 = PointInCurve(Point=living_points, Curve=graft(rectangle_3.Rectangle))  # -> Relationship, Point
equality_2 = Equality(FirstNumber=point_in_curve_2.Relationship, SecondNumber="1")  # -> Equality, Inequality
number_2 = Number(equality_2.Equality)
mass_addition_2 = MassAddition(Input=number_2)  # -> flatten(Result), PartialResults

# ----
how_many_neighbors_each_dead_point_has = Number(mass_addition_2.Result)
how_many_neighbors_each_living_cell_has = Number(mass_addition.Result)

# ---- group: Death check for LIVING cells
smaller_than = SmallerThan(FirstNumber=how_many_neighbors_each_living_cell_has, SecondNumber=Slider(2, range=0..8))  # -> SmallerThan, OrEqualTo
larger_than = LargerThan(FirstNumber=how_many_neighbors_each_living_cell_has, SecondNumber=Slider(3, range=0..8))  # -> LargerThan, OrEqualTo
gate_or = GateOr(A=smaller_than.SmallerThan, B=larger_than.LargerThan)

# ----
equality_3 = Equality(FirstNumber=how_many_neighbors_each_dead_point_has, SecondNumber=Slider(3, range=0..10))  # -> Equality, Inequality
cull_pattern = CullPattern(List=living_points, CullPattern=invert(gate_or))
cull_pattern_2 = CullPattern(List=surrounding_dead_points, CullPattern=invert(equality_3.Inequality))
stayed_alive = Point(cull_pattern)
became_alive = Point(cull_pattern_2)

multiplication = Multiplication(A=loop_start.Counter, B="10")
addition = Addition(A=multiplication, B="10")
unit_z = UnitZ(Factor=addition)

merge_3 = Merge(Data1=stayed_alive, Data2=became_alive)  # -> flatten(Result)
next_generation = Point(merge_3)
move_2 = Move(Geometry=next_generation, Motion=unit_z)  # -> Geometry, Transform
merge_4 = Merge(Data1=loop_start.Data_2, Data2=move_2.Geometry)
loop_end = LoopEnd(
    port=loop_start.port,
    Exit=False,
    Data=next_generation,
    Data_2=merge_4,
    TimeOutVal=0,
    pausedState=False,
    state="Constant output")  # -> Data, D1
number_slider = Slider(10, range=0..10)
recorded_points = Point(loop_end.D1)
data_dam = DataDam(DataDataA=recorded_points, BufferDelay=10000000, BufferMode=2)
point_charge = PointCharge(Point=data_dam, Radius=number_slider, ChargeStrength=Slider(1, range=0..1))
cocoon = Cocoon(Charges=point_charge, Iso=Slider(0.8, range=0..1), CellSize=number_slider, Execute=Toggle(True), Simple=False)  # -> Mesh, RefinementData
weaverbird_s_catmull_clark_subdivision = WeaverbirdsCatmullClarkSubdivision(MeshCurves=cocoon.Mesh, Level=Slider(1, range=0..10), SmoothNakedEdges=1)
